# Grasshopper definition SimpleTest.gh (Grasshopper 1.0.4)
# plug-ins: KangarooExample

rectangle = Rectangle(Plane=PlaneXY(0, 0, 0), XSize="0 to 10", YSize="0 to 10", Radius=0)  # -> Rectangle, Length
number_slider = Slider(0, range=0..20)
int = Integer("10")
mplane = MeshPlane(Boundary=rectangle.Rectangle, WidthCount=int, HeightCount=int)  # -> Mesh, Area
examplesim = KangarooExample(Mesh=mplane.Mesh, Force=Slider(0.168, range=0..1))

# ---- group: output
mesh = Mesh(examplesim)
